# Dynamo graph PDFCreator.dyn "PDFCreatorTool_v1.2" (Dynamo 2.0.2.6826)

# group: Usage Notes
# note: Script Version: 1.2
# Dynamo Version: 2.0.1
# Author: Paul Fassnidge
# Date: 14/03/19
# Contact: paulfassnidge@hydrock.com
# Released Notes: Simplifying Category selection and Print setting nodes
# Packages Used:
# ArchiLab, Data-Shapes, Genius Loci
# Instructions:
# IMPORTANT - PLEASE CLOSE AND REOPEN DYNAMO SCRIPT AFTER EACH RUN FOR BEST PERFORMANCE
# SET BLUEBEAM AS YOUR DEFAULT PDF PRINTER AND READER
# 1) In the blue boxes select your chosen directory for the PDF sheets to be sent to
# 2) Run the script and select your chosen sheets from the pop up window and press select.
# 3) PDF sheets should now be in your chosen folder

# group: User inputs
select_where_the_pdfs_are_going = Directory("C:\Users\paulfassnidge\Documents\test_print")  # "Select where the PDFs are going to be saved to:"; graph input
print_settings = PrintSettingUi(index=1)  # graph input

# group: Select sheet UI
code_block = CodeBlock { "BPE PDF Generator"; }
file_path = Filename("..\..\..\OneDrive - Hydrock Consultants Ltd\BPE_Labs\bpe_labs.jpg")
code_block_2 = CodeBlock { "Select Sheets"; }
code_block_3 = CodeBlock { Category.ByName(["Sheets"]); }
all_elements_of_category = ElementsOfCategory(Category=code_block_3)
flatten = List.Flatten(list=all_elements_of_category)
code_block_4 = CodeBlock { "Sheet Name"; }
getParameterValueByName = Element.GetParameterValueByName(element=flatten, parameterName=code_block_4)
ui_listview_data = Custom[UI.Listview Data](InputName=code_block_2, Keys_var=getParameterValueByName, Values_var=flatten)  # Create data for ListView input in UI.MultiInputForm ++ . Check out www.data-shapes.net for more infos.
boolean = BoolSelector(true)
code_block_5 = CodeBlock { "Cancel"; }
code_block_6 = CodeBlock { 800; }
ui_multipleinputform = Custom[UI.MultipleInputForm ++](Description_optional=code_block, Logo_optional=file_path, Inputs=ui_listview_data, Toggle=boolean, CancelButtonText_optional=code_block_5, Width_optional=code_block_6)  # Create a form with multiple inputs. see www.data-shapes.net for tutorials and infos!

# group: Get naming Params
code_block_7 = CodeBlock { "File Name - Project Code"; }
getParameterValueByName_2 = Element.GetParameterValueByName(element=ui_multipleinputform.User_Inputs, parameterName=code_block_7)
code_block_8 = CodeBlock { "File Name - Originator"; }
getParameterValueByName_3 = Element.GetParameterValueByName(element=ui_multipleinputform.User_Inputs, parameterName=code_block_8)
code_block_9 = CodeBlock { "File Name - Zone"; }
getParameterValueByName_4 = Element.GetParameterValueByName(element=ui_multipleinputform.User_Inputs, parameterName=code_block_9)
code_block_10 = CodeBlock { "File Name - Level"; }
getParameterValueByName_5 = Element.GetParameterValueByName(element=ui_multipleinputform.User_Inputs, parameterName=code_block_10)
code_block_11 = CodeBlock { "File Name - Type"; }
getParameterValueByName_6 = Element.GetParameterValueByName(element=ui_multipleinputform.User_Inputs, parameterName=code_block_11)
sheetNumber = Sheet.SheetNumber(sheet=ui_multipleinputform.User_Inputs)
sheetName = Sheet.SheetName(sheet=ui_multipleinputform.User_Inputs)

# group: Concat name details
code_block_12 = CodeBlock(list1=getParameterValueByName_2, list2=getParameterValueByName_3, list3=getParameterValueByName_4, list4=getParameterValueByName_5, list5=getParameterValueByName_6, list6=sheetNumber, list7=sheetName) { list1 + "-" + list2 + "-" + list3 + "-" + list4 + "-" + list5 + "-" + list6 + "-" + list7; }
list_create = List.Create(item0=[code_block_12, code_block_12])
additionals = CodeBlock { ""; ""; }
string_from_list = Custom[String From List](List=list_create@L2, Suffix=additionals.out0, Seperator=additionals.out1)  # This node will take an input of a list or nested list and then join each element in a list with a given seperator while adding a suffix.

# group: Write PDFs
filenameToFilePaths = Custom[FilenameToFilePaths](Directory_Path=select_where_the_pdfs_are_going, Filenames=string_from_list)  # Add directory and .pdf extension to filenames.
list_create_2 = List.Create(item0=filenameToFilePaths)
flatten_2 = List.Flatten(list=list_create_2)
list_create_3 = List.Create(item0=ui_multipleinputform.User_Inputs)
flatten_3 = List.Flatten(list=list_create_3)
string = StringInput("Bluebeam PDF")
print_range = StringInput("Select")
boolean_2 = BoolSelector(true)
print_pdf_multiple_formats = Custom[Print PDF (multiple formats)](FilePaths=flatten_2, Views=flatten_3, PrintSetting=print_settings, PrinterName=string, PrintRange=print_range, RunIt=boolean_2)  # This node will allow you to initiate a printing routine from a set of views/sheets, filename, printer name, print settings with many formats and print range. Use MergePDFs node to combine files. From archilab.
are_your_files_created = Watch(print_pdf_multiple_formats)
