# Dynamo graph publishertool.dyn (Dynamo 2.0.3.8810)

# group: Usage Notes
# note: Script Version: 1.4.6
# Dynamo Version: 2.0.2+
# Author: Paul Fassnidge
# Date: 25/09/20
# Contact: paulfassnidge@hydrock.com
# Released Notes:
# Add Destination Folder Path to UI
# Packages Used:
# Data-Shapes version: 2019.2.42

# group: USER INPUTS
# note: USED:
# FOR USER SELECTIONS, SETTINGS AND GRAPH VARIABLES

# group: CREATE IN REVIT
# note: USED:
# FOR THE CREATION OF ELEMENTS IN THE REVIT WORKSPACE

# group: GET DATA
# note: USED:
# FOR THE DISCOVERY AND RETRIVAL OF INFORMATION

# group: WRITE DATA
# note: USED:
# FOR INSTANCES WHICH CREATE  AND EXPORT DATA TO REVIT OR EXTERNAL SOFTWARES/DIRECTORIES

# group: GRAPH PROCESS COLOR CODING
# note: DYNAMO GRAPHIC STANDARDS APPLIED

# group: CREATE IN DYNAMO
# note: USED:
# IN CREATION OR ADAPTATION OF GEOMETRY IN THE DYNAMO WORKSPACE

# group: PROCESS DATA
# note: USED:
# AS A GENERAL DEFINITION FOR CASES OF DATA PROCESSING

logo = Python()  # unwired: IN[0]
# ---------- logo.python (9 lines) ----------
#Generate User Specific Path 
#PFassnidge v1.1 250920

import clr
from System import Environment

path = "C:\Users\{0}\Hydrock Consultants Ltd\BPE - BPE File Explorer\BIM\Digital\Repo\images\HDT.jpg"
args = (Environment.UserName,IN[0])
OUT = path.format(*args)
# ----------------------------------------

# group: User UI
code_block = CodeBlock { "BPE Publisher Tool"; }
code_block_2 = CodeBlock { "Print"; }
code_block_3 = CodeBlock { "Enter Bluebeam Print Name e.g. Bluebeam PDF"; }
code_block_4 = CodeBlock { "Bluebeam PDF"; }
ui_textbox_data = Custom[UI.TextBox Data](InputName=code_block_3, DefaultText=code_block_4)  # Create Data for TextBox input in UI.MultipleInputForm ++ . Check out www.data-shapes.net for more informations
code_block_5 = CodeBlock { "Select Print Setting (Check Revit Print Settings if not sure)"; }
get_document = Python()
# ---------- get_document.python (29 lines) ----------
# Copyright(c) 2015, Konrad K Sobon
# @arch_laboratory, http://archi-lab.net

# Import DocumentManager
import clr
clr.AddReference("RevitServices")
import RevitServices
from RevitServices.Persistence import DocumentManager

import sys
pyt_path = r'C:\Program Files (x86)\IronPython 2.7\Lib'
sys.path.append(pyt_path)

#The inputs to this node will be stored as a list in the IN variable.
dataEnteringNode = IN

try:
	errorReport = None
	doc = DocumentManager.Instance.CurrentDBDocument
except:
	# if error accurs anywhere in the process catch it
	import traceback
	errorReport = traceback.format_exc()

#Assign your output to the OUT variable
if errorReport == None:
	OUT = doc
else:
	OUT = errorReport
# ----------------------------------------
pass_through = CodeBlock(out=get_document) { _out; }
printsettings = Python(IN[0]=pass_through)
# ---------- printsettings.python (27 lines) ----------
#Copyright(c) 2015, Konrad Sobon
# @arch_laboratory, http://archi-lab.net

import clr

clr.AddReference("RevitServices")
import RevitServices
from RevitServices.Persistence import DocumentManager

clr.AddReference("RevitAPI")
import Autodesk
from Autodesk.Revit.DB import *

inputdoc = UnwrapElement(IN[0])

#Part of script from Clockwork
if inputdoc == None:
	doc = DocumentManager.Instance.CurrentDBDocument
elif inputdoc.GetType().ToString() == "Autodesk.Revit.DB.RevitLinkInstance":
	doc = inputdoc.GetLinkDocument()
elif inputdoc.GetType().ToString() == "Autodesk.Revit.DB.Document":
	doc = inputdoc
else: doc = None

ps = FilteredElementCollector(doc).OfClass(PrintSetting)

OUT = [i for i in ps],[i.Name for i in ps]
# ----------------------------------------
code_block_6 = CodeBlock(x=printsettings) { x[0]; x[1]; }
code_block_7 = CodeBlock(PrintsettingName=code_block_6.out1) { PrintsettingName; }
code_block_8 = CodeBlock(Printsetting=code_block_6.out0) { Printsetting; }
ui_radiobuttons_data = Custom[UI.RadioButtons Data](InputName=code_block_5, Keys=code_block_7, Values=code_block_8)  # Create radio buttons input for UI.MultipleInputForm ++ .
code_block_9 = CodeBlock { "Filename Format Contains"; }
code_block_10 = CodeBlock { true; }
code_block_11 = CodeBlock { "Sheet Number"; }
ui_boolean_input = Custom[UI.Boolean input](InputName=code_block_9, DefaultValue=code_block_10, SideText=code_block_11)  # Creates a boolean input for UI.MultipleInputForm ++ . Check out www.data-shapes.net for more infos!
code_block_12 = CodeBlock { false; }
code_block_13 = CodeBlock { "Sheet Name"; }
ui_boolean_input_2 = Custom[UI.Boolean input](DefaultValue=code_block_12, SideText=code_block_13)
code_block_14 = CodeBlock { false; }
code_block_15 = CodeBlock { "Revision"; }
ui_boolean_input_3 = Custom[UI.Boolean input](DefaultValue=code_block_14, SideText=code_block_15)
code_block_16 = CodeBlock { false; }
code_block_17 = CodeBlock { "Status Code"; }
ui_boolean_input_4 = Custom[UI.Boolean input](DefaultValue=code_block_16, SideText=code_block_17)
code_block_18 = CodeBlock { "Select File Format Required"; }
code_block_19 = CodeBlock { false; }
code_block_20 = CodeBlock { "PDF"; }
ui_boolean_input_5 = Custom[UI.Boolean input](InputName=code_block_18, DefaultValue=code_block_19, SideText=code_block_20)
code_block_21 = CodeBlock { false; }
code_block_22 = CodeBlock { "DWG"; }
ui_boolean_input_6 = Custom[UI.Boolean input](DefaultValue=code_block_21, SideText=code_block_22)
code_block_23 = CodeBlock { "Select Sheets"; }
get_document_2 = Python()  # same code as get_document
get_sheets = Python(IN[0]=get_document_2)
# ---------- get_sheets.python (24 lines) ----------
import clr
clr.AddReference('RevitAPI')
from Autodesk.Revit.DB import *
import Autodesk

clr.AddReference("RevitServices")
import RevitServices
from RevitServices.Persistence import DocumentManager

inputdoc = UnwrapElement(IN[0])
if inputdoc == None:
	doc = DocumentManager.Instance.CurrentDBDocument
elif inputdoc.GetType().ToString() == "Autodesk.Revit.DB.RevitLinkInstance":
	doc = inputdoc.GetLinkDocument()
elif inputdoc.GetType().ToString() == "Autodesk.Revit.DB.Document":
	doc = inputdoc
else: doc = None

collector = FilteredElementCollector(doc)
views = collector.OfClass(ViewSheet).ToElements()
viewlist = list()
for view in views:
	viewlist.append(view)
OUT = viewlist
# ----------------------------------------
flatten = List.Flatten(list=get_sheets)
code_block_24 = CodeBlock { "Sheet Number"; }
getParameterValueByName = Element.GetParameterValueByName(element=flatten, parameterName=code_block_24)
code_block_25 = CodeBlock { "Sheet Name"; }
getParameterValueByName_2 = Element.GetParameterValueByName(element=flatten, parameterName=code_block_25)
code_block_26 = CodeBlock { "Revision"; }
getParameterValueByName_3 = Element.GetParameterValueByName(element=flatten, parameterName=code_block_26)
code_block_27 = CodeBlock { "Status Code"; }
getParameterValueByName_4 = Element.GetParameterValueByName(element=flatten, parameterName=code_block_27)
code_block_28 = CodeBlock(list1=getParameterValueByName, list2=getParameterValueByName_2, list3=getParameterValueByName_3, list4=getParameterValueByName_4) { list1 + "-" + list2 + "-" + list3 + "-" + list4; }
code_block_29 = CodeBlock { false; }
ui_listview_data = Custom[UI.Listview Data](InputName=code_block_23, Keys=code_block_28, Values=flatten, ShowId_optionnal=code_block_29)  # Create data for ListView input in UI.MultiInputForm ++ . Check out www.data-shapes.net for more infos.
list_create = List.Create(item0=ui_textbox_data, item1=ui_radiobuttons_data, item2=ui_boolean_input, item3=ui_boolean_input_2, item4=ui_boolean_input_3, item5=ui_boolean_input_4, item6=ui_boolean_input_5, item7=ui_boolean_input_6, item8=ui_listview_data)
code_block_30 = CodeBlock { true; }
code_block_31 = CodeBlock { "Cancel"; }
code_block_32 = CodeBlock { 800; }
ui_multipleinputform = Custom[UI.MultipleInputForm ++](Description_optional=code_block, Logo_optional=logo, ButtonText_optional=code_block_2, Inputs=list_create, Toggle=code_block_30, CancelButtonText_optional=code_block_31, MaxHeight_optional=code_block_32, Width_optional=code_block_32)  # Create a form with multiple inputs. see www.data-shapes.net for tutorials and infos!

# group: Sort Input Data
code_block_33 = CodeBlock { 8; }
getItemAtIndex = List.GetItemAtIndex(list=ui_multipleinputform.User_Inputs, index=code_block_33)
code_block_34 = CodeBlock { 0; }
getItemAtIndex_2 = List.GetItemAtIndex(list=ui_multipleinputform.User_Inputs, index=code_block_34)
code_block_35 = CodeBlock { 1; }
getItemAtIndex_3 = List.GetItemAtIndex(list=ui_multipleinputform.User_Inputs, index=code_block_35)
flatten_2 = List.Flatten(list=getItemAtIndex_3)
code_block_36 = CodeBlock { 2; }
getItemAtIndex_4 = List.GetItemAtIndex(list=ui_multipleinputform.User_Inputs, index=code_block_36)
code_block_37 = CodeBlock { 3; }
getItemAtIndex_5 = List.GetItemAtIndex(list=ui_multipleinputform.User_Inputs, index=code_block_37)
code_block_38 = CodeBlock { 4; }
getItemAtIndex_6 = List.GetItemAtIndex(list=ui_multipleinputform.User_Inputs, index=code_block_38)
code_block_39 = CodeBlock { 5; }
getItemAtIndex_7 = List.GetItemAtIndex(list=ui_multipleinputform.User_Inputs, index=code_block_39)
list_create_2 = List.Create(item0=getItemAtIndex_4, item1=getItemAtIndex_5, item2=getItemAtIndex_6, item3=getItemAtIndex_7)
code_block_40 = CodeBlock { 6; }
getItemAtIndex_8 = List.GetItemAtIndex(list=ui_multipleinputform.User_Inputs, index=code_block_40)
code_block_41 = CodeBlock { 7; }
getItemAtIndex_9 = List.GetItemAtIndex(list=ui_multipleinputform.User_Inputs, index=code_block_41)

# group: Get naming Params
code_block_42 = CodeBlock { "File Name - Project Code"; }
getParameterValueByName_5 = Element.GetParameterValueByName(element=getItemAtIndex, parameterName=code_block_42)
code_block_43 = CodeBlock { "File Name - Originator"; }
getParameterValueByName_6 = Element.GetParameterValueByName(element=getItemAtIndex, parameterName=code_block_43)
code_block_44 = CodeBlock { "File Name - Zone"; }
getParameterValueByName_7 = Element.GetParameterValueByName(element=getItemAtIndex, parameterName=code_block_44)
code_block_45 = CodeBlock { "File Name - Level"; }
getParameterValueByName_8 = Element.GetParameterValueByName(element=getItemAtIndex, parameterName=code_block_45)
code_block_46 = CodeBlock { "File Name - Type"; }
getParameterValueByName_9 = Element.GetParameterValueByName(element=getItemAtIndex, parameterName=code_block_46)
code_block_47 = CodeBlock { "File Name - Role"; }
getParameterValueByName_10 = Element.GetParameterValueByName(element=getItemAtIndex, parameterName=code_block_47)
sheetNumber = Sheet.SheetNumber(sheet=getItemAtIndex)
sheetName = Sheet.SheetName(sheet=getItemAtIndex)
code_block_48 = CodeBlock { "Revision"; }
getParameterValueByName_11 = Element.GetParameterValueByName(element=getItemAtIndex, parameterName=code_block_48)

# group: Compile Drawing Number
code_block_49 = CodeBlock(list1=getParameterValueByName_5, list2=getParameterValueByName_6, list3=getParameterValueByName_7, list4=getParameterValueByName_8, list5=getParameterValueByName_9, list6=getParameterValueByName_10, list7=sheetNumber) { list1 + "-" + list2 + "-" + list3 + "-" + list4 + "-" + list5 + "-" + list6 + "-" + list7; }
code_block_50 = CodeBlock { "--"; }
code_block_51 = CodeBlock { "-"; }
replace = String.Replace(str=code_block_49, searchFor=code_block_50, replaceWith=code_block_51)

# group: Filename Logic
code_block_52 = CodeBlock { 0; }
getItemAtIndex_10 = List.GetItemAtIndex(list=list_create_2, index=code_block_52)
code_block_53 = CodeBlock { ""; }
if_ = If(test=getItemAtIndex_10, true=replace, false=code_block_53)
code_block_54 = CodeBlock { ""; }
eq = if_ == code_block_54
code_block_55 = CodeBlock { ""; }
code_block_56 = CodeBlock { "_"; }
operators = if_ + code_block_56
if_2 = If(test=eq, true=code_block_55, false=operators)
flatten_3 = List.Flatten(list=if_2)

# group: Prevent directory character break
code_block_57 = CodeBlock { "/"; }
code_block_58 = CodeBlock { "+"; }
replace_2 = String.Replace(str=sheetName, searchFor=code_block_57, replaceWith=code_block_58)

# group: Filename Logic
code_block_59 = CodeBlock { 1; }
getItemAtIndex_11 = List.GetItemAtIndex(list=list_create_2, index=code_block_59)
code_block_60 = CodeBlock { ""; }
if_3 = If(test=getItemAtIndex_11, true=replace_2, false=code_block_60)
code_block_61 = CodeBlock { ""; }
eq_2 = if_3 == code_block_61
code_block_62 = CodeBlock { ""; }
code_block_63 = CodeBlock { "_"; }
operators_2 = if_3 + code_block_63
if_4 = If(test=eq_2, true=code_block_62, false=operators_2)
flatten_4 = List.Flatten(list=if_4)

# group: Filename Logic
code_block_64 = CodeBlock { 2; }
getItemAtIndex_12 = List.GetItemAtIndex(list=list_create_2, index=code_block_64)
code_block_65 = CodeBlock { ""; }
if_5 = If(test=getItemAtIndex_12, true=getParameterValueByName_11, false=code_block_65)
code_block_66 = CodeBlock { ""; }
eq_3 = if_5 == code_block_66
code_block_67 = CodeBlock { ""; }
code_block_68 = CodeBlock { "_"; }
operators_3 = if_5 + code_block_68
if_6 = If(test=eq_3, true=code_block_67, false=operators_3)
flatten_5 = List.Flatten(list=if_6)

# group: Check and write Construction Code Status and generate
code_block_69 = CodeBlock { ["S0","S1","S2","S3","S4","S6","S7","D1","D2","D3","D4","A2","A3","A4","A5","B2","B3","B4","B5","CR"]; }
flatten_6 = List.Flatten(list=code_block_69)
flatten_7 = List.Flatten(list=getItemAtIndex)
code_block_70 = CodeBlock(sheet=flatten_7) { sheet; }
titleblock_from_sheet = Python(IN[0]=code_block_70)
# ---------- titleblock_from_sheet.python (21 lines) ----------
#Alban de Chasteigner 2019
#twitter : @geniusloci_bim
#geniusloci.bim@gmail.com

import clr
# Import RevitAPI Classes
clr.AddReference('RevitAPI')
from Autodesk.Revit.DB import *

if isinstance(IN[0], list) : sheets = UnwrapElement(IN[0])
else : sheets = [UnwrapElement(IN[0])]

titleBlock=[]
for sheet in sheets:
	doc=sheet.Document
	title=FilteredElementCollector(doc,sheet.Id).OfCategory(BuiltInCategory.OST_TitleBlocks).ToElements()
	titleBlock.append(title)

#Assign your output to the OUT variable.
if isinstance(IN[0], list): OUT = titleBlock
else: OUT = titleBlock[0]
# ----------------------------------------
code_block_71 = CodeBlock(TitleBlock=titleblock_from_sheet) { TitleBlock; }
getParameterValueByName_12 = Element.GetParameterValueByName(element=code_block_71@L3, parameterName=code_block_69, lacing=Longest)
transpose = List.Transpose(lists=getParameterValueByName_12)
flatten_8 = List.Flatten(list=transpose@L3)
code_block_72 = CodeBlock { true; }
code_block_73 = CodeBlock { false; }
if_7 = If(test=flatten_8, true=code_block_72, false=code_block_73)
filterByBoolMask = List.FilterByBoolMask(list=flatten_6, mask=if_7@L2)

# group: Filename Logic
code_block_74 = CodeBlock { 3; }
getItemAtIndex_13 = List.GetItemAtIndex(list=list_create_2, index=code_block_74)
code_block_75 = CodeBlock { ""; }
if_8 = If(test=getItemAtIndex_13, true=filterByBoolMask.in, false=code_block_75)
code_block_76 = CodeBlock { ""; }
eq_4 = if_8 == code_block_76
code_block_77 = CodeBlock { ""; }
code_block_78 = CodeBlock { "_"; }
operators_4 = if_8 + code_block_78
if_9 = If(test=eq_4, true=code_block_77, false=operators_4)
flatten_9 = List.Flatten(list=if_9)

# group: Compile File Paths
get_path = Python()  # unwired: IN[0]
# ---------- get_path.python (9 lines) ----------
#Generate User Specific Path 
#PFassnidge v1.1 250920

import clr
from System import Environment

path = "C:\Users\{0}\Desktop\Print"
args = (Environment.UserName,IN[0])
OUT = path.format(*args)
# ----------------------------------------
code_block_79 = CodeBlock(DirectoryPath=get_path) { DirectoryPath; }
code_block_80 = CodeBlock(list1=flatten_3, list2=flatten_4, list3=flatten_5, list4=flatten_9) { list1 + list2 + list3 + list4; }
length = String.Length(str=code_block_80)
flatten_10 = List.Flatten(list=length)
code_block_81 = CodeBlock(x=flatten_10) { x-1; }
code_block_82 = CodeBlock { 1; }
remove = String.Remove(str=code_block_80, startIndex=code_block_81, count=code_block_82)
flatten_11 = List.Flatten(list=remove)
code_block_83 = CodeBlock(Filenames=flatten_11) { Filenames; }
code_block_84 = CodeBlock(Directorypath=code_block_79, Filename=code_block_83) { Directorypath+"\\"+Filename+".pdf"; }
code_block_85 = CodeBlock(FilePaths=code_block_84) { FilePaths; }

# group: Print
list_create_3 = List.Create(item0=getItemAtIndex)
flatten_12 = List.Flatten(list=list_create_3)
print_range = StringInput("Select")
code_block_86 = CodeBlock(PrintRange=print_range) { PrintRange; }
code_block_87 = CodeBlock { true; }
code_block_88 = CodeBlock(PrinterName=getItemAtIndex_2) { PrinterName; }
code_block_89 = CodeBlock(PrintSetting=flatten_2) { PrintSetting; }
flatten_13 = List.Flatten(list=code_block_85)
code_block_90 = CodeBlock(FilePaths=flatten_13) { FilePaths; }
count = List.Count(list=code_block_90)
ofRepeatedItem = List.OfRepeatedItem(item=code_block_89, amount=count)
flatten_14 = List.Flatten(list=ofRepeatedItem)
print_pdf = Python(IN[0]=flatten_12, IN[1]=code_block_86, IN[2]=code_block_87, IN[3]=code_block_88, IN[4]=flatten_14, IN[5]=code_block_90, IN[6]=getItemAtIndex_8)
# ---------- print_pdf.python (169 lines) ----------
#Copyright(c) 2015, Konrad K Sobon
# @arch_laboratory, http://archi-lab.net
# Revised by viktor_kuzev
# Revised by Michael Park
# Revised by Alban de Chasteigner

import clr
clr.AddReference('ProtoGeometry')
from Autodesk.DesignScript.Geometry import *

# Import Element wrapper extension methods
clr.AddReference("RevitNodes")
import Revit
clr.ImportExtensions(Revit.Elements)

# Import geometry conversion extension methods
clr.ImportExtensions(Revit.GeometryConversion)

# Import DocumentManager and TransactionManager
clr.AddReference("RevitServices")
import RevitServices
from RevitServices.Persistence import DocumentManager
from RevitServices.Transactions import TransactionManager

doc = DocumentManager.Instance.CurrentDBDocument
uiapp = DocumentManager.Instance.CurrentUIApplication
app = uiapp.Application

# Import RevitAPI
clr.AddReference("RevitAPI")
import Autodesk
from Autodesk.Revit.DB import *

import sys
pyt_path = r'C:\Program Files (x86)\IronPython 2.7\Lib'
sys.path.append(pyt_path)
import System

# The inputs to this node will be stored as a list in the IN variable.
dataEnteringNode = IN

sheets = IN[0]
pRange = System.Enum.Parse(Autodesk.Revit.DB.PrintRange, IN[1])
combined = IN[2]
printerName = IN[3]
printSettings = IN[4]
filePath = IN[5]
runIt = IN[6]

if isinstance(filePath, list):
	s_length = len(sheets)
	fp_length = len(filePath)
	if len(sheets) == len(filePath):
		pass
	else:
		filePath = filePath * (s_length / fp_length)
		if len(filePath) == len(sheets):
			pass
		else:
			OUT = "Filepaths and Sheets weren't the same length"
			exit()

elif isinstance(filePath, str):
	filepath = [filepath] * len(sheets)

if isinstance(sheets, list):
	viewSheets = []
	for i in sheets:
		viewSheets.append(UnwrapElement(i))
else:
	viewSheets = UnwrapElement(sheets)

if isinstance(printSettings, list):
	printSetting = []
	for i in printSettings:
		printSetting.append(UnwrapElement(i))
else:
	printSetting = UnwrapElement(printSettings)

TransactionManager.Instance.EnsureInTransaction(doc)
printManager = doc.PrintManager		
printSetup = printManager.PrintSetup
printManager.SelectNewPrintDriver(printerName)
if isinstance(printSettings, list):
	printSetup.CurrentPrintSetting = printSetting[0]
else:
	printSetup.CurrentPrintSetting = printSetting
printManager.Apply()
TransactionManager.Instance.TransactionTaskDone()

def PrintView(doc, sheet, pRange, printerName, combined, filePath, printSetting):
	# create view set
	viewSet = ViewSet()
	viewSet.Insert(sheet)
	# determine print range
	printManager = doc.PrintManager
	printManager.PrintRange = pRange
	printManager.Apply()
	# make new view set current
	viewSheetSetting = printManager.ViewSheetSetting
	viewSheetSetting.CurrentViewSheetSet.Views = viewSet
	# set printer
	printManager.SelectNewPrintDriver(printerName)
	printManager.Apply()
	# set combined and print to file
	if printManager.IsVirtual:
		printManager.CombinedFile = combined
		printManager.Apply()
		printManager.PrintToFile = True
		printManager.Apply()
	else:
		printManager.CombinedFile = combined
		printManager.Apply()
		printManager.PrintToFile = False
		printManager.Apply()
	# set file path
	printManager.PrintToFileName = filePath
	printManager.Apply()
	# apply print setting
	try:
		printSetup = printManager.PrintSetup
		printSetup.CurrentPrintSetting = printSetting
		printManager.Apply()
	except:
		pass
	# save settings and submit print
	TransactionManager.Instance.EnsureInTransaction(doc)
	viewSheetSetting.SaveAs("tempSetName")
	printManager.Apply()
	printManager.SubmitPrint()
	viewSheetSetting.Delete()
	TransactionManager.Instance.TransactionTaskDone()

	return True


try:
	viewSets = FilteredElementCollector(doc).OfClass(ViewSheetSet)
	for i in viewSets:
		if i.Name == "tempSetName":
			TransactionManager.Instance.EnsureInTransaction(doc)
			doc.Delete(i.Id)
			TransactionManager.Instance.ForceCloseTransaction()
		else:
			continue

	errorReport = None
	message = "Success"
	if runIt:
		if isinstance(viewSheets, list) and isinstance(printSetting, list):
			for i, j, fp in zip(viewSheets, printSetting, filePath):
				PrintView(doc, i, pRange, printerName, combined, fp, j)
		elif isinstance(viewSheets, list) and not isinstance(printSetting, list):
			for i, fp in zip(viewSheets, filePath):
				PrintView(doc, i, pRange, printerName, combined, fp, printSetting)
		elif not isinstance(viewSheets, list) and not isinstance(printSetting, list):
			PrintView(doc, viewSheets, pRange, printerName, combined, filePath[0], printSetting)
	else:
		message = "Please tick PDF box in pop up"
except:
	# if error accurs anywhere in the process catch it
	import traceback
	errorReport = traceback.format_exc()

# Assign your output to the OUT variable
if errorReport is None:
	OUT = message
else:
	OUT = errorReport
# ----------------------------------------

# group: Export
code_block_91 = CodeBlock(DirectoryPath=code_block_79) { DirectoryPath; }
code_block_92 = CodeBlock(view=flatten_12) { view; }
code_block_93 = CodeBlock(Filename=code_block_83) { Filename; }
code_block_94 = CodeBlock { SharedCoords:bool=true; }
code_block_95 = CodeBlock { MergeViews : bool = true; }
export_dwg = Python(IN[1]=code_block_91, IN[2]=code_block_92, IN[3]=code_block_93, IN[5]=code_block_94, IN[6]=code_block_95, IN[7]=getItemAtIndex_9)  # unwired: IN[0], IN[4]
# ---------- export_dwg.python (90 lines) ----------
# Copyright(c) 2016, Konrad K Sobon
# @arch_laboratory, http://archi-lab.net

# Import Element wrapper extension methods
import clr
clr.AddReference("RevitNodes")
import Revit
clr.ImportExtensions(Revit.Elements)

# Import DocumentManager and TransactionManager
clr.AddReference("RevitServices")
import RevitServices
from RevitServices.Persistence import DocumentManager

# Import RevitAPI
clr.AddReference("RevitAPI")
import Autodesk
from Autodesk.Revit.DB import *

import System
from System.Collections.Generic import *

import sys
pyt_path = r'C:\Program Files (x86)\IronPython 2.7\Lib'
sys.path.append(pyt_path)

def ProcessList(_func, _list):
    return map( lambda x: ProcessList(_func, x) if type(x)==list else _func(x), _list )

def ProcessParallelLists(_func, *lists):
	return map( lambda *xs: ProcessParallelLists(_func, *xs) if all(type(x) is list for x in xs) else _func(*xs), *lists )

def Unwrap(item):
	return UnwrapElement(item)

if isinstance(IN[0], list) : inputdoc = ProcessList(Unwrap, IN[0])
else : inputdoc = [Unwrap(IN[0])]
#Inputdoc : Part of script by Andreas Dieckmann
if inputdoc[0] == None:
	doc = DocumentManager.Instance.CurrentDBDocument
elif inputdoc[0].GetType().ToString() == "Autodesk.Revit.DB.Document":
	doc = inputdoc[0]
elif inputdoc[0].GetType().ToString() == "Autodesk.Revit.DB.RevitLinkInstance":
	doc = inputdoc[0].GetLinkDocument()
else: doc = DocumentManager.Instance.CurrentDBDocument

folderPath = IN[1]

if isinstance(IN[2], list) : views = ProcessList(Unwrap, IN[2])
else : views = [Unwrap(IN[2])]

if isinstance(IN[3], list) : names = IN[3]
else : names = [IN[3]]

if isinstance(IN[4], list) : Predef = IN[4]
else : Predef = [IN[4]]

RunIt = IN[7]

def ExportDwg(name, view, folder = folderPath):
	options = DWGExportOptions()
	if Predef[0] == None:
		pass
	else:
		options = options.GetPredefinedOptions(doc, Predef[0])
	options.SharedCoords = IN[5]
	options.MergedViews = IN[6]
	views = List[ElementId]()
	views.Add(view.Id)
	result = doc.Export(folder, name, views, options)
	return result

if RunIt:
	try:
		errorReport = None
		# run export
		ProcessParallelLists(ExportDwg, names, views)
		
	except:
		# if error accurs anywhere in the process catch it
		import traceback
		errorReport = traceback.format_exc()
else:
	errorReport = "Please tick DWG Box in pop up"

#Assign your output to the OUT variable
if errorReport == None:
	OUT = "Success"
else:
	OUT = errorReport
# ----------------------------------------

# group: Feedback message
are_your_pdf_files_created_note = Watch(print_pdf)  # "Are your PDF files created? (Note: There can be a slight lag time for PDF Files to appear in your Print Folder)"; graph output
are_your_dwg_files_created = Watch(export_dwg)  # graph output
list_create_4 = List.Create(item0=are_your_pdf_files_created_note, item1=are_your_dwg_files_created)

# group: Data
python_script = Python()  # unwired: IN[0]
# ---------- python_script.python (22 lines) ----------
#BPE data metrics by PF

import clr
import System
from System.IO import Directory

import sys
# load python
pyt_path = r'C:\Program Files (x86)\IronPython 2.7\Lib'
sys.path.append(pyt_path)

from datetime import datetime

project = IN[0]

# get the current date and time
starttime = datetime.now().strftime("%H-%M-%S")

import os
   

OUT = starttime
# ----------------------------------------
control = CodeBlock(passthrough=list_create_4, waitfor=python_script) { [passthrough,waitfor][0]; }
python_script_2 = Python(IN[0]=control)
# ---------- python_script_2.python (35 lines) ----------
#Get project info by PF

import clr
clr.AddReference("RevitServices")
clr.AddReference('DynamoRevitDS')
import RevitServices
from RevitServices.Persistence import DocumentManager

import Dynamo 
import sys
sys.path.append(r'C:\Program Files (x86)\IronPython 2.7\Lib')

import os
DynamoRevit=Dynamo.Applications.DynamoRevit()

passthrough = IN[0]

#Get doc and dynamo stuff
doc = DocumentManager.Instance.CurrentDBDocument
app = DocumentManager.Instance.CurrentUIApplication.Application
scriptname=DynamoRevit.RevitDynamoModel.CurrentWorkspace.FileName

name=os.path.basename(scriptname)

filename,extention=os.path.splitext(name)

elementlist = list()
projinfo = doc.ProjectInformation

elementlist.append(projinfo.Name)
elementlist.append(projinfo.Number)
elementlist.append(app.Username)
elementlist.append(filename)

OUT = elementlist
# ----------------------------------------
control_2 = CodeBlock(seq=python_script_2) { seq[0]; seq[1]; seq[2]; seq[3]; }
python_script_3 = Python(IN[0]=control_2.out0, IN[1]=control_2.out1, IN[2]=control_2.out2, IN[3]=control_2.out3, IN[4]=python_script)
# ---------- python_script_3.python (42 lines) ----------
#BPE data metrics by PF

import clr
import System
from System.IO import Directory

import sys
# load python
pyt_path = r'C:\Program Files (x86)\IronPython 2.7\Lib'
sys.path.append(pyt_path)

from datetime import datetime

project = IN[0]
number = IN[1]
user = IN[2]
scriptname = IN[3]
starttime = IN[4]


# get the current date and time
datestamp = datetime.today().strftime("%Y-%m-%d")
endtime = datetime.now().strftime("%H-%M-%S")

#runtime = (endtime - starttime)
#runtime.seconds

import os

## set the output directory and gather log data
dir = 'Q:\Office\IT Software\Dynamo\data'
   
# create a directory for each user of a machine
Directory.CreateDirectory(dir)

# generate the file name for the log file
filename = (str(datestamp) + '_' +str(endtime) + '_' +str(project) + '_' +str(number) + '_' +str(scriptname) + '_' +str(starttime) + '_' +str(user) + '_' + '.txt')

# create the log file (blank text file)
logger = open(dir + '\\' + filename,'w+')

OUT = str("Run Logged")
# ----------------------------------------

# group: Dialog
end = Python(IN[0]=python_script_3)
# ---------- end.python (30 lines) ----------
# Enable Python support and load DesignScript library
import clr
clr.AddReference('RevitAPIUI')
from Autodesk.Revit.UI import TaskDialog, TaskDialogCommonButtons, TaskDialogResult, TaskDialogCommandLinkId

# Import DocumentManager and TransactionManager
clr.AddReference("RevitServices")
import RevitServices
from RevitServices.Persistence import DocumentManager
from RevitServices.Transactions import TransactionManager

mainDialog = TaskDialog("Hydrock Digital Tools")
mainDialog.MainInstruction = "Printing Finished"
mainDialog.MainContent = """Your sheets should be printing into your chosen Dynamo Print Folder. 

No sheets appeared? Maybe check: 

i)  Do all your Sheets have a Status Code added?
ii) Do all your Sheets have a Revision added?
iii) Did you tick the PDF and/or DWG box on the options pop up?

Large numbers of sheets can take time to appear in the folder so please be patient! :-)"""

mainDialog.CommonButtons = TaskDialogCommonButtons.Close;
mainDialog.DefaultButton = TaskDialogResult.Close;

tResult = mainDialog.Show()
OUT = tResult

TransactionManager.Instance.TransactionTaskDone()
# ----------------------------------------
